# Grasshopper definition TTC_Workflow_V1.gh (Grasshopper 1.0.8)
# plug-ins: Karamba3D

# ----
# INPUT for LLM:
# 
# "You can choose from this list of Crosssections"
crosecrselect = CrossSectionRangeSelectorKaramba3D(MaximumHeight_cm=-1, MaximumWidth_cm=-1, menu=[dropdown(1), dropdown(1), dropdown(2), dropdown(0)])
panel = Panel(crosecrselect)

ttc_interpreter = Python3Script(prompt="Create a Warren Truss spanning 5 metres.", run=Button())  # -> out, run_id, structure, answer; inputs prompt: String, run: Boolean
# ---------- ttc_interpreter: Python ----------
# Copy this script into a GHPython component (CPython 3, Rhino 8).
# Input 1: prompt (str) — original user prompt: what kind of structure they want to design
# Input 2: run — wire Button here; click to run (each run creates a new run_id)
# Output 1: out — same as answer (communication from LLM)
# Output 2: run_id — id for this run (for Generator step)
# Output 3: structure — filled JSON (dict)
# Output 4: answer — communication: questions for clarification or brief summary

import os
import sys

REPO_ROOT = r"C:\Users\levin\Documents\GitHub\gh-text-to-code-ai-integration"  # change if repo is elsewhere
SCRIPTS_DIR = os.path.join(REPO_ROOT, "03_python")

if SCRIPTS_DIR not in sys.path:
    sys.path.insert(0, SCRIPTS_DIR)

# Load API keys from .env at repo root (works without python-dotenv, e.g. in Rhino)
_env_path = os.path.join(REPO_ROOT, ".env")
if os.path.isfile(_env_path):
    try:
        from dotenv import load_dotenv
        load_dotenv(_env_path)
    except ImportError:
        pass
    # Fallback: read .env manually so it works in Rhino when dotenv isn't installed
    if not (os.environ.get("ANTHROPIC_API_KEY") or os.environ.get("CLAUDE_API_KEY")):
        with open(_env_path) as _f:
            for _line in _f:
                _line = _line.strip()
                if _line and not _line.startswith("#") and "=" in _line:
                    _k, _, _v = _line.partition("=")
                    _k, _v = _k.strip(), _v.strip()
                    if _v.startswith('"') and _v.endswith('"'): _v = _v[1:-1]
                    elif _v.startswith("'") and _v.endswith("'"): _v = _v[1:-1]
                    if _k: os.environ.setdefault(_k, _v)

from ttc_interpreter import parse_prompt_to_structured, get_latest_run_id

# Inputs from GH are named: prompt, run (use those names in the component)
prompt_text = str(prompt).strip() if prompt else ""
if not prompt_text:
    out = "No prompt provided."
    run_id = get_latest_run_id() or ""
    structure = {}
    answer = out
else:
    structured_prompt, communication, run_id = parse_prompt_to_structured(prompt_text, run_id=None)
    out = communication
    run_id = run_id
    structure = structured_prompt
    answer = communication

# GHPython outputs (order: out, run_id, structure, answer)
a = out
b = run_id
c = structure
d = answer
# ---------- end ttc_interpreter ----------
crosecselect = CrossSectionSelectorKaramba3D()  # -> CrossSection, Info
supp = SupportKaramba3D(Ct_kN_m=Vector(0, 0, 0), Cr_kNm_rad=Vector(0, 0, 0), menu=[buttons(on, on, on, on, on, on)])
loads = LoadsKaramba3D(Local=False, LCase="LC0", mode="Point")
loads_2 = LoadsKaramba3D(Vector=Vector(0, 0, -1), LCase="LC0", mode="Gravity")
lineelem = CreateLinearElementKaramba3D(
    CrossSection=crosecselect.CrossSection,
    LimitDistance_m=0.005,
    BucklingLengthY_m=-1,
    BucklingLengthZ_m=-1,
    BucklingLengthLT_m=-1,
    Bending=True,
    ToPolylineMaxAngle=0.25,
    ToPolylineTolerance=0.1,
    ToPolylineMaxEdgeLength=0.25,
    New=True,
    Remove=True,
    mode="LineToBeam",
    GuidGeneratorSeed=-236662677)  # -> Element, Points, Info
merge = Merge(Data1=loads, Data2=loads_2)
assemble = AssembleModelKaramba3D(Elem=lineelem.Element, Support=supp, Load=merge, LimitDistance_m=0.005)  # -> Model, Info, Mass_kg, CentreOfGravity, LoadCaseNames
analyse = AnalyseKaramba3D(Model=assemble.Model)  # -> AnalysedModel, MaximumDisplacement_cm, ResultingForce_kN, ChangeOfElasticEnergy_kNm
modelview = ModelViewKaramba3D(Model=analyse.AnalysedModel)  # -> Model, DeformedMesh, DeformedAxes, DeformedModel, MaximumDeformation
beamview = BeamViewKaramba3D(Model=modelview.Model)  # -> Model, MeshesOfRenderedBeams, DeformedBeamAxes, LegendColours, LegendTags
legend = LegendKaramba3D(
    Colors=beamview.LegendColours,
    Tags=beamview.LegendTags,
    Scale=0.8,
    Textsize=30,
    Legend_HasHeader=False,
    Legend_Justification=2,
    Legend_Position=2)
